# Grasshopper definition generative.gh (Grasshopper 1.0.7)
# plug-ins: jSwan

vec = VectorXYZ(XComponent=0, YComponent=0, ZComponent=0)  # -> Vector, Length
number_slider = Slider(1, range=0..10)
crv = Curve(<curve referenced from the Rhino model>)
pt = Point(vec.Vector)
divdist = DivideDistance(Curve=crv, Distance=number_slider)  # -> Points, Tangents, Parameters
geo = Geometry(flatten([pt, divdist.Points]))
pline = PolyLine(Vertices=geo, Closed=True)
geo_2 = Geometry(<curve referenced from the Rhino model>)
offset = OffsetCurve(Curve=pline, Distance=1, Plane=PlaneXY(0, 0, 0), Corners=1)
divdist_2 = DivideDistance(Curve=geo_2, Distance=number_slider)  # -> Points, Tangents, Parameters
rec_2pt = Rectangle2Pt(Plane=PlaneXY(0, 0, 0), PointA=Point(0, 0, 0), PointB=Point(10, 5, 0), Radius=0)  # -> Rectangle, Length
divdist_3 = DivideDistance(Curve=flatten(offset), Distance=number_slider)  # -> Points, Tangents, Parameters
merge = Merge(Data1=divdist_3.Points, Data2=divdist_2.Points)
rejson = SerializeJson(Interior=merge, Perimeter=flatten(geo), IncludeNullAndEmptyProperties=False)
item = ListItem(List=merge, Index=Slider(5, range=0..10), Wrap=True)
panel = Panel(rejson)
